# Grasshopper definition result.gh (Grasshopper 1.0.7)

python = GhPythonScript()  # -> out, a
# ---------- python: Python ----------
import urllib2
import json

url = "http://localhost:8000/gh_result/"
# val = {
#     "test_key1": "test_val1",
#     "test_key2": "test_val2"
#     }


data = json.loads(sd_result)
data["pnu"] = pnu
data["type"] = eval(type)
print(data)
data = json.dumps(data)
req = urllib2.Request(url, data, headers={'Content-Type' : 'application/json'})
try:
    response = urllib2.urlopen(req)
    result = json.load(response)
    print("result", result)
except Exception as e:
    print(e)
# ---------- end python ----------
